# Dynamo graph 20180307_RosaDeLosVientos_SAB.dyn (Dynamo 1.3.2.2480)

# group: INPUT2_Archivo EXCEL a leer
file_path = Filename("..\..\DBs\eval_software.ods")
code_block = CodeBlock { "Sheet1"; }

fromPath = FileObject(file_path)  # "File.FromPath"
readFromFile = Excel.ReadFromFile(file=fromPath, sheetName=code_block)
code_block_2 = CodeBlock { 0..8; }
getItemAtIndex = List.GetItemAtIndex(list=readFromFile@L2, index=code_block_2)
code_block_3 = CodeBlock { 1; }
dropItems = List.DropItems(list=getItemAtIndex@L2, amount=code_block_3)

# group: Nombres parámetros a analizar
code_block_4 = CodeBlock { 0; }
# note: encabezados
getItemAtIndex_2 = List.GetItemAtIndex(list=dropItems, index=code_block_4)

code_block_5 = CodeBlock { 1; }
dropItems_2 = List.DropItems(list=dropItems@L3, amount=code_block_5)
code_block_6 = CodeBlock { 1; }
flatten = List.Flatten(list=dropItems_2@L2, amt=code_block_6)
transpose = List.Transpose(flatten)
code_block_7 = CodeBlock { 0; }
getItemAtIndex_3 = List.GetItemAtIndex(list=transpose@L3, index=code_block_7)
count = Count(getItemAtIndex_3@L2)
code_block_8 = CodeBlock { numero=7; }
code_block_9 = CodeBlock(n=count, numero=code_block_8) { n/numero; }
code_block_10 = CodeBlock { 0; }
round = Math.Round(number=code_block_9, digits=code_block_10)
code_block_11 = CodeBlock(a=round) { a+1; }
code_block_12 = CodeBlock(n=code_block_11) { 1..n; }

# group: Distancia entre diagramas
distancia_entre_diagramas = CodeBlock { 20000; }

code_block_13 = CodeBlock(a=code_block_12, b=distancia_entre_diagramas) { a*b; }
byCoordinates = Point.ByCoordinates(x=code_block_13)
YAxis = Vector.YAxis()
reverse = Vector.Reverse(YAxis)
code_block_14 = CodeBlock(numero=code_block_8) { 1..numero; }
code_block_15 = CodeBlock(a=code_block_14, b=distancia_entre_diagramas) { a*b; }
translate = Geometry.Translate(geometry=byCoordinates, direction=reverse, distance=code_block_15, lacing=Longest)
flatten_2 = Flatten(translate)
code_block_16 = CodeBlock { 0..44; }

# group: Puntos de inserción
getItemAtIndex_4 = List.GetItemAtIndex(list=flatten_2, index=code_block_16)

code_block_17 = CodeBlock { 5000; }
byCenterPointRadius = Circle.ByCenterPointRadius(centerPoint=getItemAtIndex_4, radius=code_block_17)
ZAxis = Vector.ZAxis()
code_block_18 = CodeBlock { 90; }
rotate = Geometry.Rotate(geometry=byCenterPointRadius, origin=getItemAtIndex_4, axis=ZAxis, degrees=code_block_18)
# note: Nueva nota
code_block_19 = CodeBlock(rotCirculos=rotate) { rotCirculos; }
code_block_20 = CodeBlock { 0..1..#8; }
code_block_21 = CodeBlock { -1; }
dropItems_3 = List.DropItems(list=code_block_20, amount=code_block_21)
reverse_2 = List.Reverse(dropItems_3)
pointAtParameter = Curve.PointAtParameter(curve=code_block_19, param=reverse_2, lacing=CrossProduct)
byStartPointEndPoint = Line.ByStartPointEndPoint(startPoint=getItemAtIndex_4, endPoint=pointAtParameter)
code_block_22 = CodeBlock { 1; }
dropItems_4 = List.DropItems(list=flatten@L2, amount=code_block_22)
code_block_23 = CodeBlock(n=dropItems_4) { param= n/5; }
pointAtParameter_2 = Curve.PointAtParameter(curve=byStartPointEndPoint, param=code_block_23, lacing=Longest)
code_block_24 = CodeBlock { true; }
byPoints = PolyCurve.ByPoints(points=pointAtParameter_2, connectLastToFirst=code_block_24)
removeNulls = Lists.Manage.RemoveNulls(byPoints)
explode = Geometry.Explode(removeNulls)
create = List.Create(explode, byStartPointEndPoint, code_block_19)
flatten_3 = Flatten(create)

# group: INPUT1_Vista
views = Views("Nivel 1")

code_block_25 = CodeBlock(vista=views) { vista; }

# group: Nombres de cada diagrama
code_block_26 = CodeBlock { 1; }
getItemAtIndex_5 = List.GetItemAtIndex(list=getItemAtIndex@L2, index=code_block_26)
code_block_27 = CodeBlock { 1; }
# note: Nombres Programas
dropItems_5 = List.DropItems(list=getItemAtIndex_5, amount=code_block_27)

string_from_object = FromObject(dropItems_5)

# group: Nombre-Etiqueta por cada diagrama
code_block_28 = CodeBlock(point=getItemAtIndex_4) { point; }
YAxis_2 = Vector.YAxis()
code_block_29 = CodeBlock { 8000; }
translate_2 = Geometry.Translate(geometry=code_block_28, direction=YAxis_2, distance=code_block_29)
code_block_30 = CodeBlock { "Center"; }
code_block_31 = CodeBlock { true; }
code_block_32 = CodeBlock { 0; }
byLocation = TextNote.ByLocation(view=code_block_25, location=translate_2, text=string_from_object, alignment=code_block_30, keepRotatedTextReadable=code_block_31, rotation=code_block_32)

code_block_33 = CodeBlock { {"Sencillez","Mod_complx","Interop","Flex_Soft","Edit_soft","Edit_BIM","Comunidad"}; }

# group: Identificador por eje diagrama
code_block_34 = CodeBlock { 2000; }
extendEnd = Curve.ExtendEnd(curve=byStartPointEndPoint, distance=code_block_34)
endPoint = Curve.EndPoint(extendEnd)
flatten_4 = Flatten(endPoint)
code_block_35 = CodeBlock { 44; }
ofRepeatedItem = List.OfRepeatedItem(item=code_block_33, amount=code_block_35)
flatten_5 = Flatten(ofRepeatedItem)
string_from_object_2 = FromObject(flatten_5)
code_block_36 = CodeBlock { "Center"; }
code_block_37 = CodeBlock { true; }
code_block_38 = CodeBlock { 0; }
byLocation_2 = TextNote.ByLocation(view=code_block_25, location=flatten_4, text=string_from_object_2, alignment=code_block_36, keepRotatedTextReadable=code_block_37, rotation=code_block_38)

floor_types = FloorTypes("Genérico 150 mm")
levels = Levels("Nivel 1")

# group: Línea y trama (con suelos) de análisis del diagrama
fromCurve = Custom[DetailLine.FromCurve](curve=flatten_3, view=code_block_25)  # Creates a detail line based on a given curve
byOutlineTypeAndLevel = Floor.ByOutlineTypeAndLevel(outlineCurves=removeNulls, floorType=floor_types, level=levels)

code_block_39 = CodeBlock { 0; }
getItemAtIndex_6 = List.GetItemAtIndex(list=flatten_2, index=code_block_39)
code_block_40 = CodeBlock { "Diagramas"; }
byName = DraftingView.ByName(code_block_40)
