# Dynamo graph rosasDeLosVientos_3.dyn (Dynamo 1.3.2.2480)

# group: Archivo EXCEL a leer
file_path = Filename("..\DBs\eval_software.ods")
code_block = CodeBlock { "Sheet1"; }

fromPath = FileObject(file_path)  # "File.FromPath"
readFromFile = Excel.ReadFromFile(file=fromPath, sheetName=code_block)
code_block_2 = CodeBlock { 2; }
dropItems = List.DropItems(list=readFromFile@L2, amount=code_block_2)

# group: Nombres parámetros a analizar
code_block_3 = CodeBlock { 0; }
# note: encabezados
getItemAtIndex = List.GetItemAtIndex(list=dropItems, index=code_block_3)

dropItems_2 = List.DropItems(list=dropItems@L3, amount=code_block_2)
code_block_4 = CodeBlock { 1; }
flatten = List.Flatten(list=dropItems_2@L2, amt=code_block_4)
transpose = List.Transpose(flatten)
code_block_5 = CodeBlock { 0; }
getItemAtIndex_2 = List.GetItemAtIndex(list=transpose@L3, index=code_block_5)
count = Count(getItemAtIndex_2@L2)
code_block_6 = CodeBlock { numero=7; }
code_block_7 = CodeBlock(n=count, numero=code_block_6) { n/numero; }
code_block_8 = CodeBlock { 0; }
round = Math.Round(number=code_block_7, digits=code_block_8)
code_block_9 = CodeBlock(a=round) { a+1; }
code_block_10 = CodeBlock(n=code_block_9) { 1..n; }

# group: Distancia entre diagramas
distancia_entre_diagramas = CodeBlock { 20000; }

code_block_11 = CodeBlock(a=code_block_10, b=distancia_entre_diagramas) { a*b; }
byCoordinates = Point.ByCoordinates(x=code_block_11)
YAxis = Vector.YAxis()
code_block_12 = CodeBlock(numero=code_block_6) { 1..numero; }
code_block_13 = CodeBlock(a=code_block_12, b=distancia_entre_diagramas) { a*b; }
translate = Geometry.Translate(geometry=byCoordinates, direction=YAxis, distance=code_block_13, lacing=Longest)
flatten_2 = Flatten(translate)
code_block_14 = CodeBlock { 0..44; }

# group: Puntos de inserción
getItemAtIndex_3 = List.GetItemAtIndex(list=flatten_2, index=code_block_14)

code_block_15 = CodeBlock { 5000; }
byCenterPointRadius = Circle.ByCenterPointRadius(centerPoint=getItemAtIndex_3, radius=code_block_15)
ZAxis = Vector.ZAxis()
code_block_16 = CodeBlock { 90; }
rotate = Geometry.Rotate(geometry=byCenterPointRadius, origin=getItemAtIndex_3, axis=ZAxis, degrees=code_block_16)
code_block_17 = CodeBlock(rotCirculos=rotate) { rotCirculos; }
code_block_18 = CodeBlock { 0..1..#8; }
code_block_19 = CodeBlock { -1; }
dropItems_3 = List.DropItems(list=code_block_18, amount=code_block_19)
reverse = List.Reverse(dropItems_3)
# note: Nueva nota
pointAtParameter = Curve.PointAtParameter(curve=code_block_17, param=reverse, lacing=CrossProduct)
byStartPointEndPoint = Line.ByStartPointEndPoint(startPoint=getItemAtIndex_3, endPoint=pointAtParameter)
code_block_20 = CodeBlock(n=flatten) { param= n/5; }
pointAtParameter_2 = Curve.PointAtParameter(curve=byStartPointEndPoint, param=code_block_20, lacing=Longest)
code_block_21 = CodeBlock { true; }
byPoints = PolyCurve.ByPoints(points=pointAtParameter_2, connectLastToFirst=code_block_21)
removeNulls = Lists.Manage.RemoveNulls(byPoints)
explode = Geometry.Explode(removeNulls)
create = List.Create(explode, byStartPointEndPoint, code_block_17)
flatten_3 = Flatten(create)

# group: VISTA
views = Views("Nivel 2")

code_block_22 = CodeBlock(vista=views) { vista; }

# group: Nombres de cada diagrama
code_block_23 = CodeBlock { 1; }
getItemAtIndex_4 = List.GetItemAtIndex(list=readFromFile@L2, index=code_block_23)
code_block_24 = CodeBlock { 1; }
# note: Nombres Programas
dropItems_4 = List.DropItems(list=getItemAtIndex_4, amount=code_block_24)

string_from_object = FromObject(dropItems_4)

# group: Nombre-Etiqueta por cada diagrama
code_block_25 = CodeBlock(point=getItemAtIndex_3) { point; }
YAxis_2 = Vector.YAxis()
code_block_26 = CodeBlock { 8000; }
translate_2 = Geometry.Translate(geometry=code_block_25, direction=YAxis_2, distance=code_block_26)
code_block_27 = CodeBlock { "Center"; }
code_block_28 = CodeBlock { true; }
code_block_29 = CodeBlock { 0; }
byLocation = TextNote.ByLocation(view=views, location=translate_2, text=string_from_object, alignment=code_block_27, keepRotatedTextReadable=code_block_28, rotation=code_block_29)

code_block_30 = CodeBlock { {"Sencillez","Mod_complx","Interop","Flex_Soft","Edit_soft","Edit_BIM","Comunidad"}; }

# group: Identificador por eje diagrama
code_block_31 = CodeBlock { 2000; }
extendEnd = Curve.ExtendEnd(curve=byStartPointEndPoint, distance=code_block_31)
endPoint = Curve.EndPoint(extendEnd)
flatten_4 = Flatten(endPoint)
code_block_32 = CodeBlock { 44; }
ofRepeatedItem = List.OfRepeatedItem(item=code_block_30, amount=code_block_32)
flatten_5 = Flatten(ofRepeatedItem)
string_from_object_2 = FromObject(flatten_5)
code_block_33 = CodeBlock { "Center"; }
code_block_34 = CodeBlock { true; }
code_block_35 = CodeBlock { 0; }
byLocation_2 = TextNote.ByLocation(view=views, location=flatten_4, text=string_from_object_2, alignment=code_block_33, keepRotatedTextReadable=code_block_34, rotation=code_block_35)

floor_types = FloorTypes("Genérico 150 mm")
levels = Levels("Nivel 1")

# group: Línea y trama (con suelos) de análisis del diagrama
fromCurve = Custom[DetailLine.FromCurve](curve=flatten_3, view=code_block_22)  # Creates a detail line based on a given curve
byOutlineTypeAndLevel = Floor.ByOutlineTypeAndLevel(outlineCurves=removeNulls, floorType=floor_types, level=levels)

name = RoofType.Name()  # unwired: arg0
